# Grasshopper definition design.gh (Grasshopper 1.0.8)
# plug-ins: CORE.Grasshopper.Colibri, LadybugGrasshopper

# ----
# Define facade inputs
region1 = Slider(4, range=0..4)
region2 = Slider(4, range=0..4)
region3 = Slider(4, range=0..4)
colibri_in = ColibriInputsIterator(region1=region1, region2=region2, region3=region3, ignoreAllWarningMsg=True)  # -> U, IP, region1, region2, region3, V_N
multiplication = Multiplication(A=colibri_in.region1, B=25)
multiplication_2 = Multiplication(A=colibri_in.region2, B=25)
multiplication_3 = Multiplication(A=colibri_in.region3, B=25)

deskfracposy = Slider(0.1, range=0..1)
deskfracposx = Slider(0.5, range=0..1)
desklength = Slider(1.6, range=0..10)
deskwidth = Slider(0.8, range=0..10)
deskheight = Slider(0.8, range=0..10)
deskthickness = Slider(0.02, range=0..0.1)
desklegradius = Slider(0.02, range=0..0.1)
fractionallegposition = Slider(0.1, range=0..1)
nlayers = Slider(3, range=1..4)
innerzoneheight = Slider(3, range=-10..10)
gapthickness = Slider(0.01, range=0..0.03)
nregions = Slider(3, range=1..4)
# Set Parameters
innerzonewidth = Slider(6, range=-10..10)
innerzonedeepth = Slider(6, range=-10..10)
wallwidth = Slider(0.2, range=0..1)
window2wall = Slider(0.5, range=0..1)
glasthickness = Slider(0.004, range=0.001..0.01)
verticaleyeheight = Slider(1.2, range=0.5..1.5)

# ---- group: tint state region 1
num = Number(multiplication)

# ---- group: tint state region 2
num_2 = Number(multiplication_2)

# ---- group: tint state region 3
num_3 = Number(multiplication_3)

# ----
# Desk
series = Series(Start=0, Step=1, Count=2)
dom = ConstructDomain(DomainStart=expr("-x", desklegradius), DomainEnd=desklegradius)
subtraction = Subtraction(A=deskheight, B=deskthickness)
expression = Expression(f=fractionallegposition, l=desklength, S=series, Expression="f*l/2 + l*(1-f)*S")
box = DomainBox(Base=PlaneXY(0, 0, 0), X=dom, Y=dom, Z=subtraction)
box_2 = DomainBox(Base=PlaneXY(0, 0, 0), X=deskwidth, Y=desklength, Z=deskthickness)
expression_2 = Expression(f=fractionallegposition, l=deskwidth, S=series, Expression="f*l/2 + l*(1-f)*S")
vec = VectorXYZ(XComponent=0, YComponent=0, ZComponent=subtraction)  # -> Vector, Length
move = Move(Geometry=box_2, Motion=vec.Vector)  # -> Geometry, Transform
vec_2 = VectorXYZ(XComponent=0, YComponent=expression, ZComponent=0)  # -> Vector, Length
move_2 = Move(Geometry=box, Motion=vec_2.Vector)  # -> Geometry, Transform
vec_3 = VectorXYZ(XComponent=expression_2, YComponent=0, ZComponent=0)  # -> Vector, Length
sunion = SolidUnion(Breps=move_2.Geometry)  # -> graft(Result)
move_3 = Move(Geometry=sunion, Motion=vec_3.Vector)  # -> flatten(Geometry), Transform
expression_3 = Expression(ww=wallwidth, f=deskfracposx, l=innerzonewidth, d=deskwidth, Expression="d + ww + f*(l-2*d)")
sunion_2 = SolidUnion(Breps=[move.Geometry, move_3.Geometry])
expression_4 = Expression(ww=wallwidth, f=deskfracposy, l=innerzonedeepth, d=desklength, Expression="ww + f*(l-d)")
mirror = Mirror(Geometry=sunion_2, Plane=PlaneYZ(0, 0, 0))  # -> Geometry, Transform
group = Group(Geometry=[mirror.Geometry, sunion_2])
vec_4 = VectorXYZ(XComponent=expression_3, YComponent=expression_4, ZComponent=wallwidth)  # -> Vector, Length
move_4 = Move(Geometry=group, Motion=vec_4.Vector)  # -> Geometry, Transform
ungroup = Ungroup(Group=move_4.Geometry)
debrep = DeconstructBrep(Brep=ungroup)  # -> Faces, Edges, Vertices

multiplication_4 = Multiplication(A=wallwidth, B=2)
vec_5 = VectorXYZ(XComponent=wallwidth, YComponent=wallwidth, ZComponent=wallwidth)  # -> Vector, Length

# ----
# Ground
planesrf = PlaneSurface(Plane=PlaneXY(0, 0, 0), XSize=Domain(-1000, 1000), YSize=Domain(-1000, 1000))

# ----
# Define sensors (HB)
number_slider = Slider(0.1, range=0.1..0.5)
series_2 = Series(Start=0, Step=1, Count=2)
expression_5 = Expression(a=expression_3, b=deskwidth, c=number_slider, ser=series_2, Expression="a + (2*ser-1)*(b + c)")
expression_6 = Expression(a=expression_4, b=desklength, Expression="a + b/2")
panel = Panel("""{1,0,0}
{-1,0,0}""")
vec_6 = VectorXYZ(XComponent=expression_5, YComponent=expression_6, ZComponent=verticaleyeheight)  # -> Vector, Length
multiplication_5 = Multiplication(A=panel, B=Slider(0.7, range=0.1..1))
sensorgrid = HBSensorGrid(name="glare", positions=vec_6.Vector, directions=panel)  # -> grid; plug-in component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
vdisex = VectorDisplayEx(Point=vec_6.Vector, Vector=multiplication_5, Colour=RGB(0, 0, 0), Width=2)

# ----
# Define & Assign Surface Properties (HB)
panel_2 = Panel("opac")
opaquemod = HBOpaqueModifier(name=panel_2, reflect=Slider(0.2, range=0..1))  # -> modifier; plug-in component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
py3 = Python3Script(u=num_2)  # -> trans; inputs u: Double
# ---------- py3: Python ----------
# data from doi: https://doi.org/10.1016/j.jobe.2021.102535 Table 1
trans = 0.3158*(u/100)**3 - 0.3126*(u/100)**2 - 0.6252*(u/100) + 0.634
# ---------- end py3 ----------
py3_2 = Python3Script(u=num_3)  # -> trans; inputs u: Double; same code as py3
py3_3 = Python3Script(u=num)  # -> trans; inputs u: Double; same code as py3

# ----
# Ground
panel_3 = Panel("ground")
face = HBFace(geo=planesrf, name=panel_3, rad_mod=opaquemod)  # -> report, faces; plug-in component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

# ----
# Desk
panel_4 = Panel("desk")
face_2 = HBFace(geo=debrep.Faces, name=panel_4, rad_mod=opaquemod)  # -> report, faces; plug-in component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

concat = Concatenate(FragmentA="model_", FragmentB=num)
concat_2 = Concatenate(FragmentA=concat, FragmentB="_")
concat_3 = Concatenate(FragmentA=concat_2, FragmentB=num_2)
path = FilePath("C:\Users\siosw\Documents\01_Promotion\00_Projekte\01_gonia\tutorials\private\02_ModelTraining_TheIncidenceOperator\project\")
concat_4 = Concatenate(FragmentA=concat_3, FragmentB="_")
falsestart = LBFalseStartToggle(False)
concat_5 = Concatenate(FragmentA=concat_4, FragmentB=num_3)
concat_6 = Concatenate(FragmentA=path, FragmentB=concat_5)

# ----
# Glazing
expression_7 = Expression(n=nlayers, l=glasthickness, g=gapthickness, w=wallwidth, Expression="l/2 - (w + (n*l+(n-1)*g))/2")
addition = Addition(A=glasthickness, B=gapthickness)
series_3 = Series(Start=0, Step=1, Count=nlayers)
multiplication_6 = Multiplication(A=series_3, B=addition)
vec_7 = VectorXYZ(XComponent=0, YComponent=multiplication_6, ZComponent=0)  # -> Vector, Length
vec_8 = VectorXYZ(XComponent=0, YComponent=expression_7, ZComponent=0)  # -> Vector, Length
number_slider_2 = Slider(0, range=0..100)
series_4 = Series(Start=0, Step=2, Count=3)
addition_2 = Addition(A=series_4, B=3)
addition_3 = Addition(A=series_4, B=1)
addition_4 = Addition(A=series_4, B=2)

# ----
# Room
expression_8 = Expression(a=innerzoneheight, wwr=window2wall, Expression="1/2*a*(1+sqrt(wwr))")
expression_9 = Expression(a=innerzoneheight, wwr=window2wall, Expression="1/2*a*(1-sqrt(wwr))")
expression_10 = Expression(a=innerzonewidth, wwr=window2wall, Expression="1/2*a*(1-sqrt(wwr))")
expression_11 = Expression(a=innerzonewidth, wwr=window2wall, Expression="1/2*a*(1+sqrt(wwr))")
addition_5 = Addition(A=innerzonedeepth, B=multiplication_4)
addition_6 = Addition(A=innerzoneheight, B=multiplication_4)
# Generate Geometries
addition_7 = Addition(A=innerzonewidth, B=multiplication_4)
box_3 = DomainBox(Base=PlaneXY(0, 0, 0), X=addition_7, Y=addition_5, Z=addition_6)
box_4 = DomainBox(Base=PlaneXY(0, 0, 0), X=innerzonewidth, Y=innerzonedeepth, Z=innerzoneheight)
dom_2 = ConstructDomain(DomainStart=expr("-x", wallwidth), DomainEnd=0)
dom_3 = ConstructDomain(DomainStart=expression_10, DomainEnd=expression_11)
dom_4 = ConstructDomain(DomainStart=expression_9, DomainEnd=expression_8)
box_5 = DomainBox(Base=PlaneXY(0, 0, 0), X=dom_3, Y=dom_2, Z=dom_4)

move_5 = Move(Geometry=box_4, Motion=vec_5.Vector)  # -> Geometry, Transform
move_6 = Move(Geometry=box_5, Motion=vec_5.Vector)  # -> Geometry, Transform

debrep_2 = DeconstructBrep(Brep=move_6.Geometry)  # -> Faces, Edges, Vertices
item = ListItem(List=debrep_2.Faces, Index=Slider(2, range=0..5), Wrap=True)
move_7 = Move(Geometry=item, Motion=vec_7.Vector)  # -> Geometry, Transform
move_8 = Move(Geometry=move_7.Geometry, Motion=vec_8.Vector)  # -> Geometry, Transform
item_2 = ListItem(List=move_8.Geometry, Index=number_slider_2, Wrap=True)
sdivide = DivideSurface(Surface=item_2, UCount=nregions, VCount=1)  # -> flatten(Points), Normals, Parameters
item_3 = ListItem(List=sdivide.Points, Index=addition_4, Wrap=True)
item_4 = ListItem(List=sdivide.Points, Index=series_4, Wrap=True)
item_5 = ListItem(List=sdivide.Points, Index=addition_3, Wrap=True)
item_6 = ListItem(List=sdivide.Points, Index=addition_2, Wrap=True)
srf4pt = _4PointSurface(CornerA=item_4, CornerB=item_5, CornerC=item_6, CornerD=item_3)
item_7 = ListItem(List=srf4pt, Index=1, Wrap=True)
item_8 = ListItem(List=srf4pt, Index=2, Wrap=True)
item_9 = ListItem(List=srf4pt, Index=0, Wrap=True)
cull_i = CullIndex(List=move_8.Geometry, Indices=number_slider_2, Wrap=True)

sunion_3 = SolidUnion(Breps=[move_5.Geometry, move_6.Geometry])

# ----
# remove inner box &  window
sdiff = SolidDifference(BrepsA=box_3, BrepsB=sunion_3)

debrep_3 = DeconstructBrep(Brep=sdiff)  # -> Faces, Edges, Vertices

# ----
# Walls
panel_5 = Panel("walls")
face_3 = HBFace(geo=debrep_3.Faces, name=panel_5, rad_mod=opaquemod)  # -> report, faces; plug-in component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

# ----
# Glazing Layer 2 + 3
panel_6 = Panel("glazingLayer23")

glassmod = HBGlassModifier(name=panel_6, trans=Slider(0.9, range=0..1))  # -> modifier; plug-in component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

aperture = HBAperture(geo=cull_i, rad_mod=glassmod)  # -> report, apertures; plug-in component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

# ----
# Glazing Layer 1 Region 2
panel_7 = Panel("glazingLayer1Region2")

glassmod_2 = HBGlassModifier(name=panel_7, trans=py3)  # -> modifier; plug-in component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

aperture_2 = HBAperture(geo=item_7, name=panel_7, rad_mod=glassmod_2)  # -> report, apertures; plug-in component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

# ----
# Glazing Layer 1 Region 3
panel_8 = Panel("glazingLayer1Region3")

glassmod_3 = HBGlassModifier(name=panel_8, trans=py3_2)  # -> modifier; plug-in component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

aperture_3 = HBAperture(geo=item_8, name=panel_8, rad_mod=glassmod_3)  # -> report, apertures; plug-in component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

# ----
# Glazing Layer 1 Region 1
panel_9 = Panel("glazingLayer1Region1")

glassmod_4 = HBGlassModifier(name=panel_9, trans=py3_3)  # -> modifier; plug-in component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

aperture_4 = HBAperture(geo=item_9, name=panel_9, rad_mod=glassmod_4)  # -> report, apertures; plug-in component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

# ----
# Create Model & Write Project (HB)
model = HBModel(
    faces=flatten([face_3.faces, face_2.faces, face.faces]),
    apertures=flatten([aperture_4.apertures, aperture.apertures, aperture_2.apertures, aperture_3.apertures]))  # -> report, model; plug-in component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
assigngridsviews = HBAssignGridsAndViews(model=model.model, grids=flatten(sensorgrid))  # -> model; plug-in component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
modeltorad = HBModelToRadFolder(model=assigngridsviews, folder=concat_6, write=falsestart)  # -> report, folder; plug-in component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
txt = Text(modeltorad.folder)
panel_10 = Panel(txt)
